# Grasshopper definition hexGrid1.gh (Grasshopper 1.0.7)

pt = Point(<point referenced from the Rhino model>)
python = GhPythonScript(p1=pt)  # -> out, a, b; inputs p1: Point3d
# ---------- python: Python ----------
"""Provides a scripting component.
    Inputs:
        rx: The rx script variable
        p1
        p2: input points specifying grid dimensions
    Output:
        a: The a output variable
        b: The b output variable"""

__author__ = "jazer"

import rhinoscriptsyntax as rs
import math
import random

def hexagon(center, size, container):
    #verts = []
    for i in range(6):
        angle = math.radians(60 * i)
        x = center.X + size * math.cos(angle)
        y = center.Y + size * math.sin(angle)
        point = rs.CreatePoint(x,y,0.0)
        container.append(point)
    return container

def dist2(p0, p1):
  return (p0.X- p1.X)*(p0.X- p1.X) + (p0.Y- p1.Y)*(p0.Y- p1.Y)+(p0.Z- p1.Z)*(p0.Z- p1.Z)

def choose2(arr):
    picked_pairs = []

    while arr:
        if len(arr) < 2:
            break
       
        idx1 = random.randint(0, len(arr) - 1)
        item1 = arr.pop(idx1)  # Remove and return item at idx1

        idx2 = random.randint(0, len(arr) - 1)
        item2 = arr.pop(idx2)  # Remove and return item at idx2

        picked_pairs.append((item1, item2))

    return picked_pairs


""" create a list of points """
size = 10
pt = []
ln = []
for i in range(0,9):
    for j in range(0,32):
        offx = j%2
        centerX = p1.X + i*size*3 + offx*size*1.5
        centerY = p1.Y+ j*size*.5*math.sqrt(3)
        spots = [0, 1, 2, 3, 4, 5]
        pairs = choose2(spots)
        for pair in pairs:
            angle1 = math.radians(60 * pair[0] + 30)
            hex1 = centerX + 0.5 * math.sqrt(3) * size * math.cos(angle1)
            why1 = centerY + 0.5 * math.sqrt(3) * size * math.sin(angle1)
            pnt1 = rs.CreatePoint(hex1, why1, 0.0)
            
            angle2 = math.radians(60 * pair[1] + 30)
            hex2 = centerX + 0.5 * math.sqrt(3) * size * math.cos(angle2)
            why2 = centerY + 0.5 * math.sqrt(3) * size * math.sin(angle2)
            pnt2 = rs.CreatePoint(hex2, why2, 0.0)
            pt.append(pnt1)
            pt.append(pnt2)
            ln.append(rs.AddLine(pnt1, pnt2))
        
        
        #center = rs.CreatePoint(x, y, 0.0)
        #hexagon(center, 10, pt)
a = pt            
b = ln




"""
dist = 11**2
ln = []

for i in range(0, len(pt)):
    for j in range(i+1, len(pt)):
        ds = dist2(pt[i], pt[j])
        if ds<dist and (ds > 1):
            midP = rs.CreatePoint(.5*(pt[i].X + pt[j].X), .5*(pt[i].Y + pt[j].Y), 0.0)
            
            
            ln.append(rs.AddLine(pt[i],pt[j]))
b = ln

"""
# ---------- end python ----------
number_slider = Slider(-1, range=-7..7)
panel = Panel(python.out)
offset = OffsetCurve(Curve=python.b, Distance=Slider(0.25, range=-3..3), Corners=1)  # -> flatten(Curve)
offset_2 = OffsetCurve(Curve=python.b, Distance=Slider(-0.25, range=-7..7), Corners=1)  # -> flatten(Curve)
ext = ExtendCurve(Curve=offset_2, Type=0, Start=number_slider, End=number_slider)
ext_2 = ExtendCurve(Curve=offset, Type=0, Start=number_slider, End=number_slider)
rulesrf = RuledSurface(CurveA=ext_2, CurveB=ext)
